# Grasshopper definition solarAnalysis.gh (Grasshopper 1.0.7)
# plug-ins: BH.UI.Grasshopper

ladybug = Ladybug_Ladybug()  # -> Vviiiiiiiiiizzz; plug-in component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
number_slider = Slider(2, range=0..10)
constructlocation = Ladybug_ConstructLocation(locationName="unknown_Location", latitude=0, longitude=0, timeZone=number_slider, elevation=0)  # -> location; plug-in component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
number_slider_2 = Slider(8, range=1..31)
number_slider_3 = Slider(10, range=0..100)
sunpath = Ladybug_SunPath(
    location=constructlocation,
    hour=number_slider_3,
    day=number_slider_2,
    month=12,
    timeStep=1,
    sunPathScale=Slider(1, range=0..1),
    dailyOrAnnualSunPath=True)  # -> readMe, sunVectors, sunAltitudes, sunAzimuths, port, sunSpheresMesh, sunPathCrvs, compassCrvs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; plug-in component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
location = Location(
    Latitude=Slider(39.9451, range=-90..90),
    Longitude=Slider(36.61256, range=-180..180),
    Elevation=0,
    UtcOffset=number_slider,
    Name="Kyiv",
    Component="BH.oM.Environment.Climate.Location")
spacetime = SpaceTime(
    Location="{ \"_t\" : \"BH.oM.Environment.Climate.Location\", \"BHoM_Guid\" : \"639ae935-0402-4b60-9083-8540a513e60b\", \"Name\" : \"\", \"Fragments\" : [], \"Tags\" : [], \"CustomData\" : { }, \"Latitude\" : 0.0, \"Longitude\" : 0.0, \"Elevation\" : 0.0, \"UtcOffset\" : 0.0 }",
    Year=Slider(2020, range=0..10000),
    Month=[Slider(5, range=0..10), Slider(7, range=0..10)],
    Day=1,
    Hour=0,
    Minute=0,
    Second=0,
    Millisecond=0,
    Component="BH.oM.Environment.Climate.SpaceTime")
dom = ConstructDomain(DomainStart=Slider(3, range=1..12), DomainEnd=Slider(6, range=0..10))
geo = Geometry(sunpath.sunPathCrvs)
spacetime_2 = SpaceTime(
    Location=location,
    Year=Slider(2020, range=0..10000),
    Month=dom,
    Day=number_slider_2,
    Hour=number_slider_3,
    Minute=0,
    Second=0,
    Millisecond=0,
    Component="BH.oM.Environment.Climate.SpaceTime")
number_slider_4 = Slider(200, range=0..1000)
cir = Circle(Plane=PlaneXY(0, 0, 0), Radius=1)
merge = Merge(Data1=Slider(1, range=0..1), Data2=Slider(2, range=0..10))
solarpa = SolarPA(SpaceTime=spacetime_2, Component="{ .SolarPA")
dailypath = DailyPath(SpaceTime=spacetime_2, Component="{ .DailyPath")
mounthpaths = MounthPaths(SpaceTime=spacetime_2, Component="{ .MounthPaths")
hourpath = HourPath(SpaceTime=spacetime_2, Component="{ .HourPath")
spacetime_3 = SpaceTime(
    Location="{ \"_t\" : \"BH.oM.Environment.Climate.Location\", \"BHoM_Guid\" : \"639ae935-0402-4b60-9083-8540a513e60b\", \"Name\" : \"\", \"Fragments\" : [], \"Tags\" : [], \"CustomData\" : { }, \"Latitude\" : 0.0, \"Longitude\" : 0.0, \"Elevation\" : 0.0, \"UtcOffset\" : 0.0 }",
    Year=1900,
    Month=merge,
    Day=Slider(2, range=0..10),
    Hour=0,
    Minute=0,
    Second=0,
    Millisecond=0,
    Component="BH.oM.Environment.Climate.SpaceTime")
xy = XYPlane(Origin=Point(0, 0, 0))
crv = Curve(hourpath)
cp = ControlPoints(Curve=crv)  # -> Points, Weights, Knots
pcx = CurvePlane(Curve=graft(hourpath), Plane=xy)  # -> Points, ParamsC, ParamsP
getproperty = GetProperty(PropName="Azimuth", Component="{ .GetProperty")
shatter = Shatter(Curve=graft(hourpath), Parameters=pcx.ParamsC)
pshift = ShiftPaths(Data=shatter, Offset=-1)
item = ListItem(List=pshift, Index=0, Wrap=True)
line = LineSDL(Start="0,0,0", Direction=Vector(0, 0, 1), Length=Slider(500, range=0..1000))
